# Grasshopper definition documentation_modality.gh (Grasshopper 0.9.80)
# plug-ins: Python Interpreter

crv = Curve(<curve referenced from the Rhino model>)
number_slider = Slider(40, range=0..200)
crv_2 = Curve(<curve referenced from the Rhino model>)
rec = Rectangle({Plane=PlaneXY(13.96849734, 14.82112031, 0), Size=Domain2(u=0..279.7016205, v=0..106.0937181)})
crv_3 = Curve(<curve referenced from the Rhino model>)
flip = FlipCurve(Curve=crv)  # -> Curve, Flag

# ----
# boundary
crv_4 = Curve(<curve referenced from the Rhino model>)

crv_5 = Curve(<curve referenced from the Rhino model>)
crv_6 = Curve(<curve referenced from the Rhino model>)
divide = DivideCurve(Curve=flip.Curve, Count=number_slider, Kinks=False)  # -> Points, Tangents, Parameters
divide_2 = DivideCurve(Curve=crv_2, Count=number_slider, Kinks=False)  # -> Points, Tangents, Parameters

# ----
# Number of path
# Path density
number_slider_2 = Slider(1, range=-10..10)

# ----
# Determine path direction
number_slider_3 = Slider(84, range=0..360)
X = UnitX(Factor=1)
Y = UnitY(Factor=1)
X_2 = UnitX(Factor=1)
rotate = Rotate(Geometry=X, Angle=number_slider_3, Plane=PlaneXY(0, 0, 0))  # -> Geometry, Transform

cpoly = ControlPolygon(Curve=crv_4)  # -> Polygon, simplify(graft(Points))
pline = PolyLine(Vertices=divide_2.Points, Closed=False)
pline_2 = PolyLine(Vertices=divide.Points, Closed=False)
len = Length(Curve=crv_6)
stitchwidth = Integer(Slider(7, range=0..50))
patch = Patch(Curves=crv_5, Spans=20, Flexibility=1, Trim=True)
pop2d = Populate2D(Region=rec, Count=Slider(4, range=0..10), Seed=Slider(44, range=0..100))
end = EndPoints(Curve=crv_3)  # -> Start, End

# ----
# Path density
number_slider_4 = Slider(1, range=0..100)

crv_7 = Curve(<curve referenced from the Rhino model>)
explode = Explode(Curve=pline, Recursive=True)  # -> Segments, Vertices
explode_2 = Explode(Curve=pline_2, Recursive=True)  # -> Segments, Vertices
division = Division(A=len, B=stitchwidth)
bang = ExplodeTree(Data=cpoly.Points)  # -> Branch0, Branch1, Branch2, Branch3
srf = Surface(patch)
nurbs = NurbsCurve(Vertices=pop2d, Degree=3, Periodic=False)  # -> Curve, Length, Domain
series = Series(Start=0, Step=Slider(0.5, range=0..10), Count=Slider(2, range=0..50))
pts = Text(division)
rev = ReverseList(List=divide_2.Points)
rev_2 = ReverseList(List=explode.Segments)
end_2 = EndPoints(Curve=nurbs.Curve)  # -> Start, End
pdecon = Deconstruct(Point=bang.Branch0)  # -> XComponent, YComponent, ZComponent
pdecon_2 = Deconstruct(Point=bang.Branch2)  # -> XComponent, YComponent, ZComponent
pt = Point(end.End)
pt_2 = Point(end.Start)
pdecon_3 = Deconstruct(Point=bang.Branch0)  # -> XComponent, YComponent, ZComponent
pdecon_4 = Deconstruct(Point=bang.Branch3)  # -> XComponent, YComponent, ZComponent
multiplication = Multiplication(A=series, B=-1)
divide_3 = DivideCurve(Curve=crv_6, Count=pts, Kinks=False)  # -> flatten(Points), Tangents, Parameters
ln = Line(StartPoint=divide.Points, EndPoint=rev)
cull = CullPattern(List=explode_2.Segments, CullPattern=[False, True])
cull_2 = CullPattern(List=rev_2, CullPattern=[True, False])
contour = Contour(Shape=srf, Point=Point(0, 0, 0), Direction=rotate.Geometry, Distance=number_slider_4)
offset = Offset(Curve=crv_7, Distance=multiplication, Plane=PlaneXY(0, 0, 0), Corners=1)
weave = Weave(Pattern=[1, 2, 1, 0], Stream0=cull, Stream1=ln, Stream2=cull_2, NullGaps=False)
pdecon_5 = Deconstruct(Point=divide_3.Points)  # -> flatten(XComponent), flatten(YComponent), ZComponent
ln_2 = Line(StartPoint=end_2.Start, EndPoint=pt)
ln_3 = Line(StartPoint=end_2.End, EndPoint=pt_2)
trim = TrimTree(Tree=contour, Depth=1)

# ----
# x range
dom = ConstructDomain(DomainStart=pdecon.XComponent, DomainEnd=pdecon_2.XComponent)

# ----
# y range
dom_2 = ConstructDomain(DomainStart=pdecon_3.YComponent, DomainEnd=pdecon_4.YComponent)

divdist = DivideDistance(Curve=offset, Distance=number_slider_2)  # -> flatten(Points), Tangents, Parameters
join = JoinCurves(Curves=weave, Preserve=False)
lng = ListLength(List=trim)
flip_2 = FlipCurve(Curve=trim)  # -> Curve, Flag
merge = Merge(Data1=nurbs.Curve, Data2=ln_2, Data3=ln_3, Data4=crv_3)

# ----
# x target range
panel = Panel("65218")
dom_3 = ConstructDomain(DomainStart=panel, DomainEnd="65525")

# ----
# y target range
panel_2 = Panel("65061")
dom_4 = ConstructDomain(DomainStart=panel_2, DomainEnd="65525")

pline_3 = PolyLine(Vertices=divdist.Points, Closed=False)
repeat = RepeatData(Data=[0, 1], Length=lng)
crv_8 = Curve(join)
join_2 = JoinCurves(Curves=merge, Preserve=False)
p_n_c = PickNChoose(Pattern=repeat, Stream0=trim, Stream1=flip_2.Curve)  # -> graft(Result)
end_3 = EndPoints(Curve=p_n_c)  # -> Start, End
remap = RemapNumbers(Value=pdecon_5.XComponent, Source=dom, Target=dom_3)  # -> Mapped, Clipped
remap_2 = RemapNumbers(Value=pdecon_5.YComponent, Source=dom_2, Target=dom_4)  # -> Mapped, Clipped
merge_2 = Merge(Data1=end_3.Start, Data2=end_3.End)
int = Integer(remap.Mapped)
int_2 = Integer(remap_2.Mapped)
weave_2 = Weave(Pattern=[0, 1], Stream0=int, Stream1=int_2, NullGaps=False)  # -> simplify(Weave)
trim_2 = TrimTree(Tree=merge_2, Depth=1)
pline_4 = PolyLine(Vertices=trim_2, Closed=False)
python = GhPythonScript(x=weave_2, y=Toggle(True))  # -> out, a; inputs x: list
# ---------- python: Python ----------
__author__ = "yichinlee"

import rhinoscriptsyntax as rs
import os
import datetime
from datetime import datetime
pts = []
f = open("/Users/mac/Desktop/embroidery_project/interactive_embroidery/emb_run.pat", "w")

def test():
    f.write(str(x) + " ")
    print("done")

def check():
    for p in x:
        pts.append(p)
        f.write(str(p) + " ")
    print("finished")
    print(len(pts))
        #check whether the number is inbond
    """if len(pts)%2 != 0:
        print("not even number") 
    else:
        print("file checked")"""
    f.close()

check()
print(datetime.now())

datetime.now().strftime('%Y-%m-%d %H:%M:%S')
# ---------- end python ----------
merge_3 = Merge(Data2=pline_4)
