# Grasshopper definition interactive_emb.gh (Grasshopper 0.9.80)
# plug-ins: Python Interpreter

rec = Rectangle({Plane=PlaneXY(13.96849734, 14.82112031, 0), Size=Domain2(u=0..279.7016205, v=0..106.0937181)})
pop2d = Populate2D(Region=rec, Count=Slider(4, range=0..10), Seed=Slider(44, range=0..100))
crv = Curve(<curve referenced from the Rhino model>)
end = EndPoints(Curve=crv)  # -> Start, End
nurbs = NurbsCurve(Vertices=pop2d, Degree=3, Periodic=False)  # -> Curve, Length, Domain
pt = Point(end.End)
number_slider = Slider(26, range=0..100)
pt_2 = Point(end.Start)
end_2 = EndPoints(Curve=nurbs.Curve)  # -> Start, End
crv_2 = Curve()
crv_3 = Curve()
flip = FlipCurve(Curve=crv_2)  # -> Curve, Flag
crv_4 = Curve()
crv_5 = Curve()
ln = Line(StartPoint=end_2.Start, EndPoint=pt)
ln_2 = Line(StartPoint=end_2.End, EndPoint=pt_2)
divide = DivideCurve(Curve=crv_3, Count=number_slider, Kinks=False)  # -> Points, Tangents, Parameters
divide_2 = DivideCurve(Curve=crv_4, Count=number_slider, Kinks=False)  # -> Points, Tangents, Parameters
divide_3 = DivideCurve(Curve=crv_2, Count=number_slider, Kinks=False)  # -> Points, Tangents, Parameters
divide_4 = DivideCurve(Curve=crv_5, Count=number_slider, Kinks=False)  # -> Points, Tangents, Parameters
ln_3 = Line(StartPoint=divide_2.Points, EndPoint=divide.Points)
ln_4 = Line(StartPoint=divide_3.Points, EndPoint=divide_4.Points)
shift = ShiftList(List=divide_3.Points, Shift=1, Wrap=True)
merge = Merge(Data1=nurbs.Curve, Data2=ln, Data3=ln_2, Data4=crv)
join = JoinCurves(Curves=merge, Preserve=False)
jitter = Jitter(List=divide.Points, Jitter=Slider(0.3, range=0..1), Seed=2)  # -> Values, Indices
crv_6 = Curve([<curve referenced from the Rhino model> x708])
ln_5 = Line(StartPoint=jitter.Values, EndPoint=divide_3.Points)
crv_7 = Curve()
# turn surface into cross sewing path
patch = Patch(Curves=crv_7, Spans=20, Flexibility=1, Trim=True)
join_2 = JoinCurves(Curves=[ln_3, ln_5, ln_4], Preserve=False)
crv_8 = Curve(<curve referenced from the Rhino model>)
number_slider_2 = Slider(1, range=0..5)
# turn surface into linear sewing path
patch_2 = Patch(Curves=crv_8, Spans=20, Flexibility=1, Trim=True)
Y = UnitY(Factor=1)
X = UnitX(Factor=1)
number_slider_3 = Slider(3, range=0..5)
X_2 = UnitX(Factor=1)
srf = Surface(patch)
rec_2 = Rectangle({Plane=PlaneXY(261.1971042, -1180.969477, 0), Size=Domain2(u=0..307, v=0..464)})
number_slider_4 = Slider(40, range=0..200)
number_slider_5 = Slider(50, range=0..100)
# turn curve outline into sprial sewing path
crv_9 = Curve(<curve referenced from the Rhino model>)
rotate = Rotate(Geometry=X_2, Angle=Slider(84, range=0..360), Plane=PlaneXY(0, 0, 0))  # -> Geometry, Transform
Y_2 = UnitY(Factor=1)
X_3 = UnitX(Factor=1)
contour = Contour(Shape=srf, Point=Point(0, 0, 0), Direction=Y, Distance=number_slider_2)
contour_2 = Contour(Shape=srf, Point=Point(0, 0, 0), Direction=X, Distance=number_slider_2)
# bridging two curves
crv_10 = Curve(<curve referenced from the Rhino model>)
srf_2 = Surface(patch_2)
crv_11 = Curve(<curve referenced from the Rhino model>)
drec = DeconstuctRectangle(Rectangle=rec_2)  # -> BasePlane, XInterval, YInterval
trim = TrimTree(Tree=contour, Depth=1)
trim_2 = TrimTree(Tree=contour_2, Depth=1)
flip_2 = FlipCurve(Curve=crv_10)  # -> Curve, Flag
dedom2num = DeconstructDomain²(Domain=drec.XInterval)  # -> UMin, UMax, VMin, VMax
contour_3 = Contour(Shape=srf_2, Point=Point(0, 0, 0), Direction=Y_2, Distance=Slider(8, range=0..100))
dedom2num_2 = DeconstructDomain²(Domain=drec.YInterval)  # -> UMin, UMax, VMin, VMax
series = Series(Start=0, Step=Slider(7, range=0..10), Count=Slider(20, range=0..50))
divide_5 = DivideCurve(Curve=crv_11, Count=number_slider_4, Kinks=False)  # -> Points, Tangents, Parameters
divide_6 = DivideCurve(Curve=flip_2.Curve, Count=number_slider_4, Kinks=False)  # -> Points, Tangents, Parameters
lng = ListLength()
flip_3 = FlipCurve(Curve=trim)  # -> Curve, Flag
lng_2 = ListLength(List=trim_2)
flip_4 = FlipCurve(Curve=trim_2)  # -> Curve, Flag
multiplication = Multiplication(A=dedom2num.UMax, B=Slider(0.2, range=0..1))
multiplication_2 = Multiplication(A=series, B=-1)
trim_3 = TrimTree(Tree=contour_3, Depth=1)
rev = ReverseList(List=divide_5.Points)
pline = PolyLine(Vertices=divide_5.Points, Closed=False)
repeat = RepeatData(Data=[0, 1], Length=lng)
pline_2 = PolyLine(Vertices=divide_6.Points, Closed=False)
repeat_2 = RepeatData(Data=[0, 1], Length=lng_2)
offset = Offset(Curve=crv_9, Distance=multiplication_2, Plane=PlaneXY(0, 0, 0), Corners=1)
lng_3 = ListLength(List=trim_3)
flip_5 = FlipCurve(Curve=trim_3)  # -> Curve, Flag
p_n_c = PickNChoose(Pattern=repeat, Stream0=trim, Stream1=flip_3.Curve)  # -> graft(Result)
p_n_c_2 = PickNChoose(Pattern=repeat_2, Stream0=trim_2, Stream1=flip_4.Curve)  # -> graft(Result)
ln_6 = Line(StartPoint=divide_6.Points, EndPoint=rev)
explode = Explode(Curve=pline, Recursive=True)  # -> Segments, Vertices
explode_2 = Explode(Curve=pline_2, Recursive=True)  # -> Segments, Vertices
repeat_3 = RepeatData(Data=[0, 1], Length=lng_3)
divdist = DivideDistance(Curve=offset, Distance=Slider(6, range=-10..10))  # -> flatten(Points), Tangents, Parameters
multiplication_3 = Multiplication(A=dedom2num_2.UMax, B=Slider(0.6, range=0..1))
end_3 = EndPoints(Curve=p_n_c)  # -> Start, End
end_4 = EndPoints(Curve=p_n_c_2)  # -> Start, End
p_n_c_3 = PickNChoose(Pattern=repeat_3, Stream0=trim_3, Stream1=flip_5.Curve)  # -> graft(Result)
rev_2 = ReverseList(List=explode.Segments)
xy = XYPlane(Origin=Point(0, 0, 0))
merge_2 = Merge(Data1=end_3.Start, Data2=end_3.End)
crv_12 = Curve(<curve referenced from the Rhino model>)
patch_3 = Patch(Curves=crv_12, Spans=20, Flexibility=1, Trim=True)
divide_7 = DivideCurve(Curve=crv_12, Count=Slider(20, range=0..20), Kinks=False)  # -> Points, Tangents, Parameters
popgeo = PopulateGeometry(Geometry=patch_3, Count=Slider(21, range=0..100), Seed=Slider(52, range=0..100))
merge_3 = Merge(Data1=divide_7.Points, Data2=popgeo)

# ----
# shortest path
jitter_2 = Jitter(List=merge_3, Jitter=1, Seed=2)  # -> Values, Indices
pdecon = Deconstruct(Point=jitter_2.Values)  # -> XComponent, YComponent, ZComponent
python = PythonScript(x=pdecon.XComponent, y=pdecon.YComponent)  # -> out, a; inputs x: list, y: list
# ---------- python: Python ----------
__author__ = "mac"

import rhinoscriptsyntax as rs

toVisit = set(list(map(lambda i: (x[i],y[i]), range(len(x)))))

path = []
current = toVisit.pop()
path.append(current)

dist = lambda x,y: ((x[0] - x[1])**2 + (y[0] - y[1])**2) ** 0.5

shortest = -1
shortestPoint = None

while len(toVisit) >0:
	for point in toVisit:
		distance = dist(current, point)
		if shortest == -1 or distance < shortest:
			shortest = distance
			shortestPoint = point
	path.append(shortestPoint)
	current = shortestPoint
	shortest = -1
	toVisit.remove(shortestPoint)


a = path
# ---------- end python ----------
python_2 = PythonScript(x=python.a)  # -> out, a, b
# ---------- python_2: Python ----------
__author__ = "mac"

import rhinoscriptsyntax as rs

a = x[0]
b = x[1]
# ---------- end python_2 ----------
pt_3 = ConstructPoint(XCoordinate=python_2.a, YCoordinate=python_2.b, ZCoordinate=0)
pline_3 = PolyLine(Vertices=pt_3, Closed=False)

merge_4 = Merge(Data1=end_4.Start, Data2=end_4.End)
pline_4 = PolyLine(Vertices=divdist.Points, Closed=False)
cull = CullPattern(List=explode_2.Segments, CullPattern=[False, True])
cull_2 = CullPattern(List=rev_2, CullPattern=[True, False])
end_5 = EndPoints(Curve=p_n_c_3)  # -> Start, End
panel = Panel(jitter_2.Values)
con = DelaunayEdges(Points=merge_3, Plane=PlaneXY(0, 0, 0))  # -> Connectivity, Edges
trim_4 = TrimTree(Tree=merge_2, Depth=1)
trim_5 = TrimTree(Tree=merge_4, Depth=1)
rectangle = Rectangle(Plane=xy, XSize=multiplication, YSize=multiplication_3, Radius=0)  # -> Rectangle, Length
merge_5 = Merge(Data1=end_5.Start, Data2=end_5.End)
panel_2 = Panel(merge_3)
weave = Weave(Pattern=[1, 2, 1, 0], Stream0=cull, Stream1=ln_6, Stream2=cull_2, NullGaps=False)
boundary = BoundarySurfaces(Edges=con.Edges)
pline_5 = PolyLine(Vertices=trim_4, Closed=False)
pline_6 = PolyLine(Vertices=trim_5, Closed=False)
trim_6 = TrimTree(Tree=merge_5, Depth=1)
join_3 = JoinCurves(Curves=weave, Preserve=False)
panel_3 = Panel(rectangle.Rectangle)
area = Area(Geometry=boundary)  # -> Area, Centroid
merge_6 = Merge(Data1=pline_5, Data2=pline_6)
crv_13 = Curve(join_3)
pline_7 = PolyLine(Vertices=trim_6, Closed=False)
merge_7 = Merge(Data2=pline_7)
pop2d_2 = Populate2D(Region=rectangle.Rectangle, Count=Slider(8, range=0..100), Seed=1)
panel_4 = Panel(con.Connectivity)
sort_pt = SortPoints(Points=pop2d_2)  # -> Points, Indices
panel_5 = Panel(boundary)
# generate .pat file
crv_14 = Curve(pline_4)

crv_15 = Curve()
len = Length(Curve=crv_15)
stitchwidth = Integer(Slider(7, range=0..50))
division = Division(A=len, B=stitchwidth)
pts = Text(division)
divide_8 = DivideCurve(Curve=crv_15, Count=pts, Kinks=False)  # -> flatten(Points), Tangents, Parameters
pdecon_2 = Deconstruct(Point=divide_8.Points)  # -> flatten(XComponent), flatten(YComponent), ZComponent

# ----
# boundary
crv_16 = Curve(<curve referenced from the Rhino model>)

# ----
# boundary
crv_17 = Curve(<curve referenced from the Rhino model>)

crv_18 = Curve(<curve referenced from the Rhino model>)
crv_19 = Curve(<curve referenced from the Rhino model>)
smoothpline = SmoothPolyline(Polyline=crv_19, Strength=1, Times=1)
pt_4 = Point()
smoothpline_2 = SmoothPolyline(Polyline=crv_18, Strength=1, Times=1)
order = PointOrder(Points=pt_4)
end_6 = EndPoints(Curve=smoothpline_2)  # -> Start, End
pdecon_3 = Deconstruct(Point=pt_4)  # -> XComponent, YComponent, ZComponent
end_7 = EndPoints(Curve=smoothpline)  # -> Start, End

# ----
# y target range
panel_6 = Panel("65525")
dom = ConstructDomain(DomainStart="65061", DomainEnd=panel_6)

# ----
# x target range
panel_7 = Panel("65218")
dom_2 = ConstructDomain(DomainStart=panel_7, DomainEnd="65525")

# ----
# y target range
panel_8 = Panel("65525")
dom_3 = ConstructDomain(DomainStart="65061", DomainEnd=panel_8)

# ----
# x target range
panel_9 = Panel("65218")
dom_4 = ConstructDomain(DomainStart=panel_9, DomainEnd="65525")

ln_7 = Line(StartPoint=end_7.End, EndPoint=end_6.End)
ln_8 = Line(StartPoint=end_7.Start, EndPoint=end_6.Start)
pline_8 = PolyLine(Vertices=pt_4, Closed=False)
merge_8 = Merge(Data1=smoothpline, Data2=ln_8, Data3=ln_7, Data4=smoothpline_2)
item = ListItem(Index=0, Wrap=True)
join_4 = JoinCurves(Curves=merge_8, Preserve=False)
bbox = BoundingBox(Content=join_4, Plane=PlaneXY(0, 0, 0))  # -> Box, Box_2
pop2d_3 = Populate2D(Region=bbox.Box, Count=Slider(4, range=0..10), Seed=1)
bzspan = BezierSpan(StartPoint=end_7.Start, EndPoint=end_6.Start)  # -> Curve, Length, Domain

cpoly = ControlPolygon(Curve=crv_16)  # -> Polygon, simplify(graft(Points))
panel_10 = Panel(cpoly.Points)
bang = ExplodeTree(Data=panel_10)  # -> Branch0, Branch1, Branch2, Branch3
pdecon_4 = Deconstruct(Point=bang.Branch0)  # -> XComponent, YComponent, ZComponent
pdecon_5 = Deconstruct(Point=bang.Branch2)  # -> XComponent, YComponent, ZComponent
pdecon_6 = Deconstruct(Point=bang.Branch0)  # -> XComponent, YComponent, ZComponent
pdecon_7 = Deconstruct(Point=bang.Branch3)  # -> XComponent, YComponent, ZComponent

# ----
# x range
dom_5 = ConstructDomain(DomainStart=pdecon_4.XComponent, DomainEnd=pdecon_5.XComponent)

# ----
# y range
dom_6 = ConstructDomain(DomainStart=pdecon_6.YComponent, DomainEnd=pdecon_7.YComponent)

remap = RemapNumbers(Value=pdecon_2.XComponent, Source=dom_5, Target=dom_2)  # -> Mapped, Clipped
remap_2 = RemapNumbers(Value=pdecon_2.YComponent, Source=dom_6, Target=dom)  # -> Mapped, Clipped

int = Integer(remap.Mapped)
int_2 = Integer(remap_2.Mapped)
weave_2 = Weave(Pattern=[0, 1], Stream0=int, Stream1=int_2, NullGaps=False)  # -> simplify(Weave)
python_3 = GhPythonScript(x=weave_2, y=Toggle(True))  # -> out, a; inputs x: list
# ---------- python_3: Python ----------
__author__ = "yichinlee"

import rhinoscriptsyntax as rs
import os
import datetime
from datetime import datetime
pts = []
f = open("/Users/mac/Desktop/embroidery_project/interactive_embroidery/emb_run.pat", "w")

def test():
    f.write(str(x) + " ")
    print("done")

def check():
    for p in x:
        pts.append(p)
        f.write(str(p) + " ")
    print("finished")
    print(len(pts))
        #check whether the number is inbond
    """if len(pts)%2 != 0:
        print("not even number") 
    else:
        print("file checked")"""
    f.close()

check()
print(datetime.now())

datetime.now().strftime('%Y-%m-%d %H:%M:%S')
# ---------- end python_3 ----------
panel_11 = Panel(python_3.out)

cpoly_2 = ControlPolygon(Curve=crv_17)  # -> Polygon, simplify(graft(Points))
panel_12 = Panel(cpoly_2.Points)
bang_2 = ExplodeTree(Data=panel_12)  # -> Branch0, Branch1, Branch2, Branch3
pdecon_8 = Deconstruct(Point=bang_2.Branch0)  # -> XComponent, YComponent, ZComponent
pdecon_9 = Deconstruct(Point=bang_2.Branch2)  # -> XComponent, YComponent, ZComponent
pdecon_10 = Deconstruct(Point=bang_2.Branch0)  # -> XComponent, YComponent, ZComponent
pdecon_11 = Deconstruct(Point=bang_2.Branch3)  # -> XComponent, YComponent, ZComponent

# ----
# x range
dom_7 = ConstructDomain(DomainStart=pdecon_8.XComponent, DomainEnd=pdecon_9.XComponent)

# ----
# y range
dom_8 = ConstructDomain(DomainStart=pdecon_10.YComponent, DomainEnd=pdecon_11.YComponent)

remap_3 = RemapNumbers(Value=pdecon_3.XComponent, Source=dom_7, Target=dom_4)  # -> Mapped, Clipped
remap_4 = RemapNumbers(Value=pdecon_3.YComponent, Source=dom_8, Target=dom_3)  # -> Mapped, Clipped

int_3 = Integer(remap_3.Mapped)
int_4 = Integer(remap_4.Mapped)
weave_3 = Weave(Pattern=[0, 1], Stream0=int_3, Stream1=int_4, NullGaps=False)  # -> simplify(Weave)
python_4 = GhPythonScript(x=weave_3, y=Toggle(False))  # -> out, a; inputs x: list; same code as python_3
panel_13 = Panel(python_4.out)
