# Grasshopper definition sketch_rnn.gh (Grasshopper 0.9.80)
# plug-ins: Python Interpreter

python = PythonScript()  # -> out, data_x, data_y, lines
# ---------- python: Python ----------
f1 = open("/Users/mac/Desktop/thesis_img_processing/pointsOnCurve_x", "r")
f2 = open("/Users/mac/Desktop/thesis_img_processing/pointsOnCurve_y", "r")
pts_x = f1.read()
pts_y = f2.read()
import string
import rhinoscriptsyntax as rs


temp_x = []
data_x = []
temp_y = []
data_y = []

for line in pts_x.strip().split('\n'):
	for i in line.strip().split(','):
		if i == "---":
			data_x.append(temp_x)
			temp_x = []
		else:
			temp_x.append(i)

for line in pts_y.strip().split('\n'):
	for i in line.strip().split(','):
		if i == "---":
			data_y.append(temp_y)
			temp_y = []
		else:
			temp_y.append(i)


lines = []

for i in range(len(data_x)):
	line = []
	pnt = []
	for j in range(len(data_x[i])):
		pnt.append(rs.AddPoint((data_x[i][j], data_y[i][j],0)))
	
	lines.append(rs.AddPolyline(pnt))
# ---------- end python ----------

# ----
# corners
python_2 = PythonScript()  # -> out, cornerx, cornery
# ---------- python_2: Python ----------
__author__ = "mac"

import rhinoscriptsyntax as rs


f1 = open("/Users/mac/Desktop/thesis_img_processing/pointsOnCurve", "r")
f2 = open("/Users/mac/Desktop/thesis_img_processing/boundary.txt", "r")
pts_data = f1.read()
corner = f2.read()
print(len(pts_data))

def get_data(data):
	temp = []
	res = []
	left_id = 0
	right_id = 0
	ptx = []
	pty = []

	for i in range(len(data)):
		if data[i] == '(':
			left_id = i
		elif data[i] == ')':
			right_id = i
			temp.append(data[(left_id+1):right_id])

	for i in range(len(temp)):
		for j in range(len(temp[i])):
			if temp[i][j] == ",":
				ptx.append(temp[i][:j])
				pty.append(temp[i][j+2:])

	return(ptx,pty)

ptx = get_data(pts_data)[0]
pty = get_data(pts_data)[1]

cornerx = get_data(corner)[0]
cornery = get_data(corner)[1]

print("cornerX=",cornerx)
print("cornerY=",cornery)

left_x = cornerx[0]
right_x = cornerx[1]
lower_y = cornery[1]
upper_y = cornery[0]

target_x = []
target_y = []

for i in range(len(ptx)):
	if float(ptx[i]) > float(left_x) and float(ptx[i]) < float(right_x) and float(pty[i]) > float(lower_y) and float(pty[i]) < float(upper_y) :
		target_x.append(ptx[i])
		target_y.append(pty[i])


print(len(target_x))
# ---------- end python_2 ----------

python_3 = PythonScript()  # -> out, x, y
# ---------- python_3: Python ----------
f1 = open("/Users/mac/Desktop/thesis_img_processing/pointsOnCurve", "r")
f2 = open("/Users/mac/Desktop/thesis_img_processing/boundary.txt", "r")
pts_data = f1.read()
corner = f2.read()
x = []
y = []
left_bond = 0
lower_bond = 0

#read data from txt file and store them as tuple into a list
def get_data(data):
	temp = []
	left_id = 0
	right_id = 0
	pts = []

	for i in range(len(data)):
		if data[i] == '(':
			left_id = i
		elif data[i] == ')':
			right_id = i
			temp.append(data[(left_id+1):right_id])

	for i in range(len(temp)):
		for j in range(len(temp[i])):
			if temp[i][j] == ",":
				pts.append((float(temp[i][:j]),float(temp[i][j+2:])))
	return(pts)

# trim the edge
def get_target():
	pts = get_data(pts_data)
	print(len(pts))
	corners = get_data(corner)

	#find_bonds
	tempx = []
	tempy = []
	for i in corners:
		tempx.append(i[0])
		tempy.append(i[1])
	
	tempx = sorted(tempx)
	tempy = sorted(tempy)

	left_bond = tempy[0] +10
	right_bond = tempy[3] -10
	lower_bond = tempx[0] +10
	upper_bond = tempx[3] -10
	
	print(left_bond, right_bond, lower_bond, upper_bond)
	target_pts = []
	for i in range(len(pts)):
		if pts[i][0] > left_bond and pts[i][0] < right_bond and pts[i][1] > lower_bond and pts[i][1] < upper_bond :
			target_pts.append([pts[i][0],pts[i][1]])

	for i in range(len(target_pts)):
		x.append(target_pts[i][0])
		y.append(target_pts[i][1])
	print(len(x))
get_target()
# ---------- end python_3 ----------
xz = XZPlane(Origin=Point(0, 0, 0))
pt = ConstructPoint(XCoordinate=python_3.x, YCoordinate=python_3.y, ZCoordinate=0)
pt_2 = ConstructPoint(XCoordinate=python_2.cornery, YCoordinate=python_2.cornerx, ZCoordinate=0)
mirror = Mirror(Geometry=pt_2, Plane=PlaneYZ(0, 0, 0))  # -> Geometry, Transform
mirror_2 = Mirror(Geometry=python.lines, Plane=PlaneYZ(0, 0, 0))  # -> Geometry, Transform
mirror_3 = Mirror(Geometry=mirror.Geometry, Plane=xz)  # -> Geometry, Transform
xz_2 = XZPlane(Origin=Point(0, 0, 0))
sort_pt = SortPoints(Points=mirror_3.Geometry)  # -> Points, Indices
mirror_4 = Mirror(Geometry=mirror_2.Geometry, Plane=xz_2)  # -> Geometry, Transform
# input_data
# doodle_data
python_4 = PythonScript()  # -> out, x, y
# ---------- python_4: Python ----------
f1 = open("/Users/mac/Desktop/thesis_img_processing/doodle_data_gh.txt", "r")

f2 = open("/Users/mac/Desktop/thesis_img_processing/boundary.txt", "r")
pts_data = f1.read()
print(pts_data)

corner = f2.read()
x = []
y = []
left_bond = 0
lower_bond = 0

#read data from txt file and store them as tuple into a list
def get_data(data):
	temp = []
	left_id = 0
	right_id = 0
	pts = []

	for i in range(len(data)):
		if data[i] == '(':
			left_id = i
		elif data[i] == ')':
			right_id = i
			temp.append(data[(left_id+1):right_id])

	for i in range(len(temp)):
		for j in range(len(temp[i])):
			if temp[i][j] == ",":
				pts.append((float(temp[i][:j]),float(temp[i][j+2:])))
	return(pts)

def doodle_data():

	pts = get_data(pts_data)
	

	for i in range(len(pts)):
		x.append(pts[i][0])
		y.append(pts[i][1])
	
doodle_data()

		


# trim the edge
def get_target():
	pts = get_data(pts_data)
	print(len(pts))
	corners = get_data(corner)

	#find_bonds
	tempx = []
	tempy = []
	for i in corners:
		tempx.append(i[0])
		tempy.append(i[1])
	
	tempx = sorted(tempx)
	tempy = sorted(tempy)

	left_bond = tempy[0] +10
	right_bond = tempy[3] -10
	lower_bond = tempx[0] +10
	upper_bond = tempx[3] -10
	
	print(left_bond, right_bond, lower_bond, upper_bond)
	target_pts = []
	for i in range(len(pts)):
		if pts[i][0] > left_bond and pts[i][0] < right_bond and pts[i][1] > lower_bond and pts[i][1] < upper_bond :
			target_pts.append([pts[i][0],pts[i][1]])

	for i in range(len(target_pts)):
		x.append(target_pts[i][0])
		y.append(target_pts[i][1])
	print(len(x))
# ---------- end python_4 ----------
item = ListItem(List=sort_pt.Points, Index="0", Wrap=True)
item_2 = ListItem(List=sort_pt.Points, Index="1", Wrap=True)

# ----
# origin
pt_3 = Point(item)

# ----
# left_upper
pt_4 = Point(item_2)

pt_5 = ConstructPoint(XCoordinate=python_4.x, YCoordinate=python_4.y, ZCoordinate=0)
python_5 = PythonScript()  # -> out, x, y
# ---------- python_5: Python ----------
f1 = open("/Users/mac/Desktop/thesis_img_processing/input_data_gh.txt", "r")
f2 = open("/Users/mac/Desktop/thesis_img_processing/boundary.txt", "r")
pts_data = f1.read()
corner = f2.read()
x = []
y = []
left_bond = 0
lower_bond = 0

#read data from txt file and store them as tuple into a list
def get_data(data):
	temp = []
	left_id = 0
	right_id = 0
	pts = []

	for i in range(len(data)):
		if data[i] == '(':
			left_id = i
		elif data[i] == ')':
			right_id = i
			temp.append(data[(left_id+1):right_id])

	for i in range(len(temp)):
		for j in range(len(temp[i])):
			if temp[i][j] == ",":
				pts.append((float(temp[i][:j]),float(temp[i][j+2:])))
	return(pts)

def doodle_data():

	pts = get_data(pts_data)

	
	for i in range(len(pts)):
		x.append(pts[i][0])
		y.append(pts[i][1])
	print(x)

doodle_data()

		


# trim the edge
def get_target():
	pts = get_data(pts_data)
	print(len(pts))
	corners = get_data(corner)

	#find_bonds
	tempx = []
	tempy = []
	for i in corners:
		tempx.append(i[0])
		tempy.append(i[1])
	
	tempx = sorted(tempx)
	tempy = sorted(tempy)

	left_bond = tempy[0] +10
	right_bond = tempy[3] -10
	lower_bond = tempx[0] +10
	upper_bond = tempx[3] -10
	
	print(left_bond, right_bond, lower_bond, upper_bond)
	target_pts = []
	for i in range(len(pts)):
		if pts[i][0] > left_bond and pts[i][0] < right_bond and pts[i][1] > lower_bond and pts[i][1] < upper_bond :
			target_pts.append([pts[i][0],pts[i][1]])

	for i in range(len(target_pts)):
		x.append(target_pts[i][0])
		y.append(target_pts[i][1])
	print(len(x))
# ---------- end python_5 ----------
preview = CustomPreview(
    Geometry=pt_3,
    Shader={ambient=RGB(0, 0, 0), diffuse=RGB(255, 105, 180), emission=RGB(76, 32, 54), shine=0.5, specular=RGB(255, 255, 255), transparency=0})
pdecon = Deconstruct(Point=pt_4)  # -> XComponent, YComponent, ZComponent
pdecon_2 = Deconstruct(Point=pt_3)  # -> XComponent, YComponent, ZComponent
pt_6 = ConstructPoint(XCoordinate=python_5.x, YCoordinate=python_5.y, ZCoordinate=0)
subtraction = Subtraction(A=pdecon.YComponent, B=pdecon_2.YComponent)

# ----
# 0,0,0
pt_7 = Point(<point referenced from the Rhino model>)

# ----
# canvas width
panel = Panel("464")

intcrv_t = InterpolateT(Vertices=pt_5, Degree=3, TangentStart=Vector(0, 0, 0), TangentEnd=Vector(0, 0, 0), KnotStyle=1)  # -> Curve, Length, Domain
division = Division(A=panel, B=subtraction)
vec2pt = Vector2Pt(PointA=item, PointB=pt_7, Unitize=False)  # -> Vector, Length
intcrv_t_2 = InterpolateT(Vertices=pt_6, Degree=3, TangentStart=Vector(0, 0, 0), TangentEnd=Vector(0, 0, 0), KnotStyle=1)  # -> Curve, Length, Domain
move = Move(Geometry=mirror_4.Geometry, Motion=vec2pt.Vector)  # -> Geometry, Transform
scale = Scale(Geometry=move.Geometry, Center=pt_7, Factor=division)  # -> Geometry, Transform
crv = Curve(scale.Geometry)
lng = ListLength(List=crv)
pt_8 = Point([<point referenced from the Rhino model> x2764])
lng_2 = ListLength(List=pt_8)
item_3 = ListItem(List=crv, Index=Slider(0, range=0..100), Wrap=True)
item_4 = ListItem(List=crv, Index=Slider(9, range=0..100), Wrap=True)
crv_2 = Curve(item_3)
eval = EvaluateLength(Curve=crv_2, Length=0, Normalized=True)  # -> Point, Tangent, Parameter
panel_2 = Panel(eval.Point)
pt_9 = Point([<point referenced from the Rhino model> x6])
jitter = Jitter(List=pt_8, Jitter=1, Seed=2)  # -> Values, Indices
dom = ConstructDomain(DomainStart="0", DomainEnd=lng_2)
crv_3 = Curve(item_4)
preview_2 = CustomPreview(
    Geometry=crv_2,
    Shader={ambient=RGB(0, 0, 0), diffuse=RGB(255, 105, 180), emission=RGB(76, 32, 54), shine=0.5, specular=RGB(255, 255, 255), transparency=0})
panel_3 = Panel(lng)
crv_4 = Curve(item_4)
end = EndPoints(Curve=crv_4)  # -> Start, End
range = Range(Domain=dom, Steps="1")  # -> flatten(Range)
intcrv_t_3 = InterpolateT(Vertices=pt_9, Degree=3, TangentStart=Vector(0, 0, 0), TangentEnd=Vector(0, 0, 0), KnotStyle=1)  # -> Curve, Length, Domain
number_slider = Slider(0.25, range=0..1)
end_2 = EndPoints(Curve=crv_2)  # -> Start, End
random = Random(Range=range, Number=1, Seed=Slider(72, range=0..100))  # -> flatten(Random)
crv_5 = Curve(<curve referenced from the Rhino model>)
smoothpline = SmoothPolyline(Polyline=crv_2, Strength=1, Times=1)
ln = Line(StartPoint=end.Start, EndPoint=end_2.End)
ln_2 = Line(StartPoint=end_2.Start, EndPoint=end.End)
item_5 = ListItem(List=random, Index="1", Wrap=True)
addition = Addition(A=item_5, B=Slider(1, range=0..1))
dom_2 = ConstructDomain(DomainStart=item_5, DomainEnd=addition)
subset = SubList(List=jitter.Values, Domain=dom_2, Wrap=True)  # -> List, Index
pline = PolyLine(Vertices=subset.List, Closed=False)
end_3 = EndPoints(Curve=smoothpline)  # -> Start, End
merge = Merge(Data1=crv_4, Data2=ln, Data3=crv_2, Data4=ln_2)
end_4 = EndPoints(Curve=pline)  # -> Start, End
panel_4 = Panel(item_5)
bzspan = BezierSpan(StartPoint=end_4.Start, EndPoint=end_4.End)  # -> Curve, Length, Domain
merge_2 = Merge(Data1=pline, Data2=bzspan.Curve)

# ----
# canvas
rec = Rectangle({Plane=PlaneXY(0, 17.45454545, 0), Size=Domain2(u=0..307, v=0..446.5454545)})

crv_6 = Curve(<curve referenced from the Rhino model>)
random_2 = Random(Range=Domain(0, 3), Number=1, Seed=2)
pt_10 = Point([Point(-31.27727803, -94.90294007, 0), Point(25.04133344, -94.90294007, 0), Point(-23.82334416, -204.9029401, 0), Point(93.61752505, -204.9029401, 0)])
bbox = BoundingBox(Content=crv_6, Plane=PlaneXY(0, 0, 0))  # -> Box, Box_2
int = Integer(random_2)
pop2d = Populate2D(Region=bbox.Box, Count=Slider(3, range=0..10), Seed=Slider(56, range=0..100))
item_6 = ListItem(List=pt_10, Index=int, Wrap=True)
merge_3 = Merge(Data1=item_6, Data2=pop2d)  # -> flatten(Result)
pline_2 = PolyLine(Vertices=merge_3, Closed=False)
bvol = BoundaryVolume()
loft = Loft(Curves=pline_2, Options={Adjust=False, Closed=False, LoftEnds=0, LoftSimp=0, LoftType=0, Rebuild=10, Refit=0.01})
crv_7 = Curve()
sframes = SurfaceFrames(UCount=10, VCount=10)  # -> Frames, Parameters
panel_5 = Panel(loft)

# ----
# select which section
number_slider_2 = Slider(5, range=0..10)

# ----
# randomly generate 4 point, and make an area
# trim the input curve with the area
# get two points of the intersction
# make a close curve out of two points
drec = DeconstuctRectangle(Rectangle=rec)  # -> BasePlane, XInterval, YInterval
pop2d_2 = Populate2D(Region=rec, Count=Slider(4, range=0..10), Seed=Slider(30, range=0..100))
pline_3 = PolyLine(Vertices=pop2d_2, Closed=True)
boundary = BoundarySurfaces(Edges=pline_3)
contour = Contour(Curve=pline_3, Point=pop2d_2, Direction=Vector(0, 0, 1))  # -> Contours, Parameters
edges = BrepEdges(Brep=boundary)  # -> Naked, Interior, NonManifold
crv_8 = Curve(contour.Contours)
join = JoinCurves(Curves=edges.Naked, Preserve=False)
crv_9 = Curve(<curve referenced from the Rhino model>)
ccx = CurveCurve(CurveA=crv_9, CurveB=join)  # -> Points, ParamsA, ParamsB
shatter = Shatter(Curve=crv_9, Parameters=ccx.ParamsA)
item_7 = ListItem(List=shatter, Index=number_slider_2, Wrap=True)
bbox_2 = BoundingBox(Content=crv_9, Plane=PlaneXY(0, 0, 0))  # -> Box, Box_2
crv_10 = Curve(item_7)
end_5 = EndPoints(Curve=crv_10)  # -> Start, End
pop2d_3 = Populate2D(Region=bbox_2.Box, Count="4", Seed=Slider(36, range=0..100))
item_8 = ListItem(List=pop2d_3, Index="0", Wrap=True)
item_9 = ListItem(List=pop2d_3, Index="1", Wrap=True)
item_10 = ListItem(List=pop2d_3, Index="2", Wrap=True)
item_11 = ListItem(List=pop2d_3, Index="3", Wrap=True)
ln_3 = Line(StartPoint=end_5.Start, EndPoint=end_5.End)
vec2pt_2 = Vector2Pt(PointA=item_10, PointB=item_11, Unitize=False)  # -> Vector, Length
vec2pt_3 = Vector2Pt(PointA=item_8, PointB=item_9, Unitize=False)  # -> Vector, Length
bzspan_2 = BezierSpan(StartPoint=end_5.Start, StartTangent=vec2pt_3.Vector, EndPoint=end_5.End, EndTangent=vec2pt_2.Vector)  # -> Curve, Length, Domain
merge_4 = Merge(Data1=ln_3, Data2=bzspan_2.Curve)

number_slider_3 = Slider(3, range=0..5)
# turn surface into linear sewing path
patch = Patch(Curves=crv_7, Spans=20, Flexibility=1, Trim=True)
X = UnitX(Factor=1)
Y = UnitY(Factor=1)
X_2 = UnitX(Factor=1)
rotate = Rotate(Geometry=X, Angle=Slider(210, range=0..360), Plane=PlaneXY(0, 0, 0))  # -> Geometry, Transform
srf = Surface(patch)
contour_2 = Contour(Shape=srf, Point=Point(0, 0, 0), Direction=Y, Distance=Slider(1.5, range=0..100))
trim = TrimTree(Tree=contour_2, Depth=1)
lng_3 = ListLength(List=trim)
flip = FlipCurve(Curve=trim)  # -> Curve, Flag
repeat = RepeatData(Data=[0, 1], Length=lng_3)
p_n_c = PickNChoose(Pattern=repeat, Stream0=trim, Stream1=flip.Curve)  # -> graft(Result)
end_6 = EndPoints(Curve=p_n_c)  # -> Start, End
# turn curve outline into sprial sewing path
crv_11 = Curve(<curve referenced from the Rhino model>)
merge_5 = Merge(Data1=end_6.Start, Data2=end_6.End)
series = Series(Start=0, Step=Slider(1, range=0..10), Count=Slider(6, range=0..50))
trim_2 = TrimTree(Tree=merge_5, Depth=1)
multiplication = Multiplication(A=series, B=-1)
pline_4 = PolyLine(Vertices=trim_2, Closed=False)
merge_6 = Merge(Data2=pline_4)
offset = Offset(Curve=crv_11, Distance=series, Plane=PlaneXY(0, 0, 0), Corners=1)
divdist = DivideDistance(Curve=offset, Distance=Slider(3, range=-10..10))  # -> flatten(Points), Tangents, Parameters
pline_5 = PolyLine(Vertices=divdist.Points, Closed=False)
# generate .pat file
crv_12 = Curve(<curve referenced from the Rhino model>)

crv_13 = Curve(crv_12)
len = Length(Curve=crv_13)
stitchwidth = Integer(Slider(3, range=0..50))
division_2 = Division(A=len, B=stitchwidth)
pts = Text(division_2)
divide = DivideCurve(Curve=crv_13, Count=pts, Kinks=False)  # -> flatten(Points), Tangents, Parameters
pdecon_3 = Deconstruct(Point=divide.Points)  # -> flatten(XComponent), flatten(YComponent), ZComponent

# ----
# boundary
crv_14 = Curve(<curve referenced from the Rhino model>)

# ----
# y target range
panel_6 = Panel("65525")
dom_3 = ConstructDomain(DomainStart="65061", DomainEnd=panel_6)

# ----
# x target range
panel_7 = Panel("65218")
dom_4 = ConstructDomain(DomainStart=panel_7, DomainEnd="65525")

cpoly = ControlPolygon(Curve=crv_14)  # -> Polygon, simplify(graft(Points))
panel_8 = Panel(cpoly.Points)
bang = ExplodeTree(Data=panel_8)  # -> Branch0, Branch1, Branch2, Branch3
pdecon_4 = Deconstruct(Point=bang.Branch0)  # -> XComponent, YComponent, ZComponent
pdecon_5 = Deconstruct(Point=bang.Branch2)  # -> XComponent, YComponent, ZComponent
pdecon_6 = Deconstruct(Point=bang.Branch0)  # -> XComponent, YComponent, ZComponent
pdecon_7 = Deconstruct(Point=bang.Branch3)  # -> XComponent, YComponent, ZComponent

# ----
# x range
dom_5 = ConstructDomain(DomainStart=pdecon_4.XComponent, DomainEnd=pdecon_5.XComponent)

# ----
# y range
dom_6 = ConstructDomain(DomainStart=pdecon_6.YComponent, DomainEnd=pdecon_7.YComponent)

remap = RemapNumbers(Value=pdecon_3.XComponent, Source=dom_5, Target=dom_4)  # -> Mapped, Clipped
remap_2 = RemapNumbers(Value=pdecon_3.YComponent, Source=dom_6, Target=dom_3)  # -> Mapped, Clipped

int_2 = Integer(remap.Mapped)
int_3 = Integer(remap_2.Mapped)
weave = Weave(Pattern=[0, 1], Stream0=int_2, Stream1=int_3, NullGaps=False)  # -> simplify(Weave)
python_6 = GhPythonScript(x=weave, y=Toggle(False))  # -> out, a; inputs x: list
# ---------- python_6: Python ----------
__author__ = "yichinlee"

import rhinoscriptsyntax as rs
import os
import datetime
from datetime import datetime
pts = []
f = open("/Users/mac/Desktop/embroidery_project/interactive_embroidery/emb_run.pat", "w")

def test():
    f.write(str(x) + " ")
    print("done")

def check():
    for p in x:
        pts.append(p)
        f.write(str(p) + " ")
    print("finished")
    print(len(pts))
        #check whether the number is inbond
    """if len(pts)%2 != 0:
        print("not even number") 
    else:
        print("file checked")"""
    f.close()

check()
print(datetime.now())

datetime.now().strftime('%Y-%m-%d %H:%M:%S')
# ---------- end python_6 ----------
panel_9 = Panel(python_6.out)

panel_10 = Panel(weave)
